# Grasshopper definition CellPhoneStand_JW.gh (Grasshopper 1.0.8)

# notes: We are going to explore cell phone stand designs that are spherical. We will begin with an origin for our designs.
# Let us create a plane, which includes a point.
xy_plane = XYPlane(Origin=Point(0, 0, 0))
pln_cell_phone_stand_design_origin = Plane(xy_plane)
void_width_mm = Slider(1000, range=0..12000)
void_height_mm = Slider(-300, range=-300..0)
# notes: Spheres will roll, so we need a flat surface at the base of the stand. To create the flat surface we create a volume we want to subtract from the sphere. Here we create a rectangle and then a box with a negative height.
number = Number(void_width_mm)
division = Division(A=number, B="2.0")
negative = Negative(Value=division)
construct_domain = ConstructDomain(DomainStart=division, DomainEnd=negative)
# notes: we have turned off 'preview' for these objects to limit what we see.
num_void_height = Number(void_height_mm)
# notes: there are many ways to create a box. Here we create a rectangle, and then use a BoxRec object with an input of our base rectangle and a height.
pln_cell_phone_stand_design_origin_2 = Plane(pln_cell_phone_stand_design_origin)
domain = Domain(construct_domain)
void_domain = Panel(domain)
void_height = Panel(num_void_height)
rectangle = Rectangle(Plane=pln_cell_phone_stand_design_origin_2, XSize=domain, YSize=domain, Radius=0)  # -> Rectangle, Length
box_rectangle = BoxRectangle(Rectangle=rectangle.Rectangle, Height=num_void_height)
void_height_2 = Panel(box_rectangle)
# notes: The result is a Box we will use as a void to remove any part of the design model that projects below the origin plane.
pln_cell_phone_stand_design_origin_3 = Plane(pln_cell_phone_stand_design_origin_2)
brep_void = Brep(box_rectangle)

# ---- group: Parameters for the Stand Design
# notes: Let us create 2 nested spheres.
# notes: We have decided we want to be able to move the center of our spherical designs up and down relative to the design origin, so we add a 'move' transform. This moves the design origin in the Z direction [up/down] the distance given in the numeric slider
# notes: try adjusting this Z position
# notes: Here we allow adjustment of the stand origin relative to the phone.
# notes: try adjusting this Z position
# notes: In the future we may need to do something if the spheres do not touch the origin plane as this means we are proposing they float in the air above the plane.
# notes: Let us remove a cylinder from the volume to reduce the volume we need to print.
stand_origin_offset = Slider(0, range=-50..50)
unit_y = UnitY(Factor=stand_origin_offset)
move = Move(Geometry=pln_cell_phone_stand_design_origin_3, Motion=unit_y)  # -> Geometry, Transform
sphere_2_center_z = Slider(-100, range=-100..100)
sphere_1_center_z = Slider(1, range=-100..100)
pln_cell_phone_stand_design_origin_4 = Plane(move.Geometry)
cylinder_void_radius = Slider(35, range=0..100)
cylinder_length = Slider(300, range=0..300)
pln_cell_phone_stand_design_origin_5 = Plane(move.Geometry)
unit_z = UnitZ(Factor=sphere_2_center_z)
unit_z_2 = UnitZ(Factor=sphere_1_center_z)
cylinder = Cylinder(Base=pln_cell_phone_stand_design_origin_5, Radius=cylinder_void_radius, Length=cylinder_length)
move_2 = Move(Geometry=pln_cell_phone_stand_design_origin_4, Motion=unit_z)  # -> Geometry, Transform
move_3 = Move(Geometry=pln_cell_phone_stand_design_origin_4, Motion=unit_z_2)  # -> Geometry, Transform
cap_holes = CapHoles(Brep=cylinder)
sphere_1_solid_radius = Slider(26, range=0..100)
pln_cell_phone_stand_sphere_1_origin = Plane(move_3.Geometry)
pln_cell_phone_stand_sphere_2_origin = Plane(move_2.Geometry)
sphere_2_void_radius = Slider(19, range=0..100)
brep_cylinder_void = Brep(cap_holes)
sphere = Sphere(Base=pln_cell_phone_stand_sphere_1_origin, Radius=sphere_1_solid_radius)
sphere_2 = Sphere(Base=pln_cell_phone_stand_sphere_2_origin, Radius=sphere_2_void_radius)

# ----
phone_viewing_angle = Slider(74, range=0..360)
phone_viewing_orientation = Slider(1, range=0..3, expression="x*90")
# notes: This is the model of the cell phone.
# notes: Adjust the parameters until this model represents the phone you are designing for.
# notes: These parameters relate to how the phone will be used while in this stand.
pln_cell_phone_stand_design_origin_6 = Plane(pln_cell_phone_stand_design_origin_2)
# notes: These parameters relate to the dimensions of the phone
# [with the case on, if applicable].
phone_table_offset = Slider(13, range=0..300)
phone_width_mm = Slider(81, range=0..300)
phone_length_mm = Slider(165, range=0..300)
phone_corner_radius_mm = Slider(5, range=0..300)
# notes: This is a tolerance for the output.  This is related to the fabrication technique, a tolerance of 1 mm should be plenty.  If the fit is too loose, reduce this to 0.5mm.
phone_thickness = Slider(13, range=0..300)
phone_tolerance_mm = Slider(1, range=0..2)
# notes: These parameters relate to the dimensions of the phone screen and viewing range. A void is created representing the viewing frustum.
phone_screen_offset_from_edge_mm = Slider(4, range=0..300)
num_screen_inset = Slider(8, range=3..100)
num_projection_distance = Slider(200, range=0..200)
num_projection_offset = Slider(90, range=0..200)
pln_cell_phone_stand_design_origin_7 = Plane(pln_cell_phone_stand_design_origin_3)
num_phone_viewing_angle = Number(phone_viewing_angle)
brep_void_2 = Brep(brep_void)
num_phone_thickness = Number(phone_thickness)
num_phone_corner_radius = Number(phone_corner_radius_mm)
num_phone_viewing_orientation = Number(phone_viewing_orientation)
num_phone_width = Number(phone_width_mm)
num_phone_length = Number(phone_length_mm)
num_phone_table_offset = Number(phone_table_offset)
num_phone_fit_tolerance = Number(phone_tolerance_mm)
num_screen_inset_2 = Number(num_screen_inset)
num_screen_offset_from_edge = Number(phone_screen_offset_from_edge_mm)
num_projection_distance_2 = Number(num_projection_distance)
num_projection_offset_2 = Number(num_projection_offset)
cluster_cell_phone = ClusterCellPhone(
    pln_phone_location_on_table=pln_cell_phone_stand_design_origin_6,
    num_phone_viewing_angle=num_phone_viewing_angle,
    num_phone_viewing_orientation=num_phone_viewing_orientation,
    num_phone_table_offset=num_phone_table_offset,
    num_phone_width=num_phone_width,
    num_phone_length=num_phone_length,
    num_phone_corner_radius=num_phone_corner_radius,
    num_phone_thickness=num_phone_thickness,
    num_phone_fit_tolerance=num_phone_fit_tolerance,
    num_screen_offset_from_edge=num_screen_offset_from_edge,
    num_screen_projection_inset=num_screen_inset_2,
    num_projection_distance=num_projection_distance_2,
    num_projection_offset=num_projection_offset_2)  # -> pln_phone_origin_8, srf_phone_outline_surface_5, brep_phone_4, pln_phone_location_on_table_7, pln_phone_location_above_table_3, num_phone_volume_2, pt_phone_centroid_2, line_phone_center_of_gravity_2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
pln_cell_phone_stand_design_origin_8 = Plane(pln_cell_phone_stand_design_origin_7)
brep_void_3 = Brep(brep_void_2)
# notes: To make the phone visible, set the toggle to "true".
display_phone = BooleanToggle(True)
crv_phone_screen = Curve(cluster_cell_phone.crv_phone_screen_4)
brep_phone = Brep(cluster_cell_phone.brep_phone_4)
brep_phone_lens = Brep(cluster_cell_phone.brep_phone_lens_4)
display_phone_center_of_gravity_axis = BooleanToggle(True)
display_phone_field_of_view_cone = BooleanToggle(True)
display_phone_void = BooleanToggle(True)
pt_phone_centroid = Point(cluster_cell_phone.pt_phone_centroid_2)
brep_tolerance_phone = Brep(cluster_cell_phone.brep_tolerance_phone_3)
line_phone_center_of_gravity = Curve(cluster_cell_phone.line_phone_center_of_gravity_2)
brep_phone_field_of_view_cone = Brep(cluster_cell_phone.brep_phone_field_of_view_cone_4)
# notes: This output is a volume representing the void for the phone and view. This will be removed from the output of the stand design.
brep_phone_void = Brep(cluster_cell_phone.brep_phone_void_2)
solid_difference = SolidDifference(BrepsA=sphere_2, BrepsB=brep_void_3)
# notes: Let us subtract the void from the spheres to get flat bottoms.
solid_difference_2 = SolidDifference(BrepsA=sphere, BrepsB=brep_void_3)
stream_filter = StreamFilter(Gate=display_phone, Stream1=brep_phone)
stream_filter_2 = StreamFilter(Gate=display_phone, Stream1=brep_phone_lens)
stream_filter_3 = StreamFilter(Gate=display_phone, Stream1=crv_phone_screen)
stream_filter_4 = StreamFilter(Gate=display_phone_center_of_gravity_axis, Stream1=line_phone_center_of_gravity)
stream_filter_5 = StreamFilter(Gate=display_phone_void, Stream1=brep_phone_void)
stream_filter_6 = StreamFilter(Gate=display_phone_field_of_view_cone, Stream1=brep_phone_field_of_view_cone)
# notes: Let us subtract the small spherical form from the larger spherical form
solid_difference_3 = SolidDifference(BrepsA=solid_difference_2, BrepsB=solid_difference)
custom_preview = CustomPreview(Geometry=stream_filter, Material=ColourSwatch(SwatchColor=RGB(145, 145, 145)))
custom_preview_2 = CustomPreview(Geometry=stream_filter_2, Material=ColourSwatch(SwatchColor=RGB(84, 84, 84)))
custom_preview_3 = CustomPreview(Geometry=stream_filter_3, Material=ColourSwatch(SwatchColor=RGB(99, 48, 48)))
custom_preview_4 = CustomPreview(Geometry=stream_filter_4, Material=ColourSwatch(SwatchColor=RGB(255, 0, 0)))
custom_preview_5 = CustomPreview(Geometry=stream_filter_5, Material=ColourSwatch(SwatchColor=RGBA(184, 72, 72, 186)))
custom_preview_6 = CustomPreview(Geometry=stream_filter_6, Material=ColourSwatch(SwatchColor=RGBA(72, 184, 178, 44)))
# notes: Let us subtract the small spherical form from the larger spherical form
solid_difference_4 = SolidDifference(BrepsA=solid_difference_3, BrepsB=brep_cylinder_void)
brep_tolerance_phone_2 = Brep(brep_tolerance_phone)
pt_phone_centroid_2 = Point(pt_phone_centroid)
# notes: At this point we have a form for the stand that will hold the phone in the desired orientation relative to the surface it sits on.
brep_cell_phone_stand_base = Brep(solid_difference_4)
# notes: Let us remove the void representing the phone and view from the stand form.
brep_cell_phone_stand_base_2 = Brep(brep_cell_phone_stand_base)
brep_phone_void_2 = Brep(brep_phone_void)
pln_cell_phone_stand_design_origin_9 = Plane(pln_cell_phone_stand_design_origin_8)
solid_difference_5 = SolidDifference(BrepsA=brep_cell_phone_stand_base_2, BrepsB=brep_phone_void_2)
# notes: We now have a form for a stand  which will hold the phone as modeled in the desired position.
brep_cell_phone_stand_design = Brep(solid_difference_5)
brep_cell_phone_stand_design_2 = Brep(brep_cell_phone_stand_design)
pln_cell_phone_stand_design_origin_10 = Plane(pln_cell_phone_stand_design_origin_9)
brep_cell_phone_stand_design_3 = Brep(brep_cell_phone_stand_design)
pt_phone_centroid_3 = Point(pt_phone_centroid_2)
# notes: Let us test the volume of the stand is within our desired printing tolerance.
min_volume = Slider(100000, range=0..200000)
stand_max_volume = Slider(200, range=0..200, expression="x*1000")
brep_cell_phone_stand_design_4 = Brep(brep_cell_phone_stand_design_2)
# notes: Let us test that the center of gravity for the phone was inside of the stand.
center_of_gravity_test = CenterOfGravityTest(
    pt_phone_centroid=pt_phone_centroid_3,
    brep_cell_phone_stand_design=brep_cell_phone_stand_design_3,
    pln_cell_phone_stand_design_origin=pln_cell_phone_stand_design_origin_10)  # -> txt_output_messages_2, bool_stand_not_on_surface_2, bool_center_of_gravity_stable_3
color_by_volume = ColorByVolume(num_min_volume=min_volume, num_max_volume=stand_max_volume, brep=brep_cell_phone_stand_design_4)  # -> num_volume_limit_3, brep_3, bool_meetsvolumelimit_2, brep_volume_2, col_by_volume_2
panel = Panel(center_of_gravity_test.txt_output_messages_2)
pln_cell_phone_stand_design_origin_11 = Plane(pln_cell_phone_stand_design_origin_9)
color_center_of_gravity_fail = ColourSwatch(SwatchColor=RGB(255, 0, 0))
brep_cell_phone_stand_design_5 = Brep(brep_cell_phone_stand_design_2)
brep_volume = Panel(color_by_volume.brep_volume_2)
bool_center_of_gravity_stable = Boolean(center_of_gravity_test.bool_center_of_gravity_stable_3)
bool_meetsvolumelimit = Boolean(color_by_volume.bool_meetsvolumelimit_2)
num_stand_volume = Number(color_by_volume.brep_volume_2)
num_volume_limit = Number(color_by_volume.num_volume_limit_3)
col_by_volume = Colour(color_by_volume.col_by_volume_2)
stream_filter_7 = StreamFilter(Gate=bool_center_of_gravity_stable, Stream0=color_center_of_gravity_fail, Stream1=col_by_volume)
brep_cell_phone_stand_design_6 = Brep(brep_cell_phone_stand_design_5)
brep_tolerance_phone_3 = Brep(brep_tolerance_phone_2)
pt_phone_centroid_4 = Point(pt_phone_centroid_2)
col_by_volume_and_stability = Colour(stream_filter_7)
pln_cell_phone_stand_design_origin_12 = Plane(pln_cell_phone_stand_design_origin_11)
bool_meetsvolumelimit_2 = Boolean(bool_meetsvolumelimit)
num_volume_limit_2 = Number(num_volume_limit)
# notes: To see the phone in the stand, enable the phone view in the phone model.
num_stand_volume_2 = Number(num_stand_volume)
cluster_visualize_analysis = ClusterVisualizeAnalysis(
    brep_tolerance_phone=brep_tolerance_phone_3,
    pt_phone_centroid=pt_phone_centroid_4,
    brep_cell_phone_stand_design=brep_cell_phone_stand_design_6,
    pln_cell_phone_stand_design_origin=pln_cell_phone_stand_design_origin_12,
    col_by_volume_and_stability=col_by_volume_and_stability,
    bool_meetsvolumelimit=bool_meetsvolumelimit_2,
    num_volume_limit=num_volume_limit_2,
    num_stand_volume=num_stand_volume_2)
# notes: Inspect the solution. If it seems viable, bake it to the layer of your choosing (default?) and print it out.
# notes: Do the walls seem too thin?
# Does it look stable (is the center of gravity for the phone over the base)?
# notes: Can we remove a cylinder from the volume to reduce the volume we need to print?
# notes: What if we wanted to test if the stand was stable? Can we test that the center of gravity for the phone was inside of the stand?
brep_bake_me = Brep(brep_cell_phone_stand_design_5)
bool_design_isstable = Boolean(cluster_visualize_analysis)

# ==== cluster ClusterCellPhone
num_phone_viewing_angle = ClusterInput()
num_phone_viewing_orientation = ClusterInput()
num_phone_table_offset = ClusterInput()
pln_phone_location_on_table = ClusterInput()
num_phone_width = ClusterInput()
num_phone_length = ClusterInput()
num_phone_corner_radius = ClusterInput()
num_phone_thickness = ClusterInput()
num_phone_fit_tolerance = ClusterInput()
num_screen_offset_from_edge = ClusterInput()
num_screen_projection_inset = ClusterInput()
num_projection_distance = ClusterInput()
num_projection_offset = ClusterInput()
num_phone_viewing_angle_2 = Number(num_phone_viewing_angle)
num_phone_table_offset_2 = Number(num_phone_table_offset)
num_phone_viewing_orientation_2 = Number(num_phone_viewing_orientation)
# notes: let us construct an origin point for the cell phone.
notes = Panel("phone body")
phone_location_x_coordinate = Slider(0, range=0..300)
phone_location_y_coordinate = Slider(0, range=0..300)
phone_location_z_coordinate = Slider(0, range=0..300)
num_projection_distance_2 = Number(num_projection_distance)
num_projection_offset_2 = Number(num_projection_offset)
num_screen_projection_inset_2 = Number(num_screen_projection_inset)
# notes: let us define the screen as an offset from the outside edge of the device
notes_2 = Panel("phone screen")
num_phone_thickness_2 = Number(num_phone_thickness)
num_phone_corner_radius_2 = Number(num_phone_corner_radius)
num_phone_width_2 = Number(num_phone_width)
num_phone_length_2 = Number(num_phone_length)
num_phone_fit_tolerance_2 = Number(num_phone_fit_tolerance)
camera35mmlenslength = Slider(24, range=18..80)
# notes: let us construct an origin point for the cell phone camera relative to the origin point of the phone.
notes_3 = Panel("phone camera lens")
# notes: let us construct a representation of the field of view for the camera.
phone_lens_view_depth = Slider(3000, range=0..3000)
phone_lens_location_x_coordinate = Slider(0, range=0..300)
phone_lens_location_y_coordinate = Slider(150, range=0..300)
phone_lens_location_z_coordinate = Slider(13, range=0..300)
phone_lens_rim_offset = Slider(3, range=0..300)
phone_lens_radius = Slider(5, range=0..25)
# notes: phone camera view frustum
phone_lens_thickness = Slider(0.5, range=0..2)
pln_phone_location_on_table_2 = Plane(pln_phone_location_on_table)
# notes: This is a point that will help us conceptually connect the virtual world to the physical world.
pt_phone_origin = ConstructPoint(
    XCoordinate=phone_location_x_coordinate,
    YCoordinate=phone_location_y_coordinate,
    ZCoordinate=phone_location_z_coordinate)
num_camera35mmlenslength = Number(camera35mmlenslength)
num_screen_offset_from_edge_2 = Number(num_screen_offset_from_edge)
vec_lens_location = VectorXYZ(
    XComponent=phone_lens_location_x_coordinate,
    YComponent=phone_lens_location_y_coordinate,
    ZComponent=phone_lens_location_z_coordinate)  # -> Vector, Length
# notes: right click on the grey box allows me to name this element.
pt_phone_origin_2 = Point(pt_phone_origin)
cluster = Cluster(num_camera35mmlenslength=num_camera35mmlenslength)
division = Division(A=num_phone_width_2, B="2.0")
# notes: a reference plane whose origin is that point
xy = XYPlane(Origin=pt_phone_origin_2)
neg = Negative(Value=division)
panel = Panel(division)
neg_2 = Negative(Value=num_screen_offset_from_edge_2)
num_fov = Number(cluster)
dom = ConstructDomain(DomainStart=division, DomainEnd=neg)
pln_phone_origin = Plane(xy)
pln_phone_origin_2 = Plane(pln_phone_origin)
move = Move(Geometry=pln_phone_origin_2, Motion=vec_lens_location.Vector)  # -> Geometry, Transform
pln_phone_lens_origin = Plane(move.Geometry)
cir = Circle(Plane=pln_phone_lens_origin, Radius=phone_lens_radius)
crv_phone_lens_outline = Curve(cir)
pln_phone_lens_origin_2 = Plane(pln_phone_lens_origin)
neg_3 = Negative(Value=phone_lens_rim_offset)
panel_2 = Panel(dom)
Z = UnitZ(Factor=phone_lens_view_depth)
# notes: here we create a fustrum that more accurately reflects the camera view and what is seen on screen.
pln_phone_lens_origin_3 = Plane(pln_phone_lens_origin)
multiplication = Multiplication(A="9", B=num_fov)
# notes: with this we can set up a view to see what the camera will see while in the stand.  we can also test whether specific object will be in the field of view.
multiplication_2 = Multiplication(A="16", B=num_fov)
offset = OffsetCurve(Curve=crv_phone_lens_outline, Distance=neg_3, Corners=1)
multiplication_3 = Multiplication(A=phone_lens_view_depth, B=multiplication)
multiplication_4 = Multiplication(A=phone_lens_view_depth, B=multiplication_2)
merge = Merge(Data1=crv_phone_lens_outline, Data2=offset)  # -> flatten(Result)
panel_3 = Panel(pln_phone_lens_origin_2)
move_2 = Move(Geometry=pln_phone_lens_origin_3, Motion=Z)  # -> Geometry, Transform
num_x_size = Number(multiplication_3)
num_y_size = Number(multiplication_4)
boundary = BoundarySurfaces(Edges=merge)
# notes: this creates a rectangle from the input of a plane, X dimension, and Y dimension.
phone_rectangle = Rectangle(Plane=pln_phone_origin, XSize=dom, YSize=num_phone_length_2, Radius=num_phone_corner_radius_2)  # -> Rectangle, Length
pln_phone_lens_origin_4 = Plane(move_2.Geometry)
num_phone_fit_tolerance_3 = Number(num_phone_fit_tolerance_2)
srf_phone_lens_outline_surface = Surface(boundary)
division_2 = Division(A=num_x_size, B="2.0")
division_3 = Division(A=num_y_size, B="2.0")
num_phone_thickness_3 = Number(num_phone_thickness_2)
rectangle_length = Panel(phone_rectangle.Length)
neg_4 = Negative(Value=division_2)
neg_5 = Negative(Value=division_3)
Z_2 = UnitZ(Factor=phone_lens_thickness)
crv_phone_outline = Curve(phone_rectangle.Rectangle)
crv_phone_outline_2 = Curve(crv_phone_outline)
offset_2 = OffsetCurve(Curve=crv_phone_outline_2, Distance=neg_2, Corners=1)
panel_4 = Panel(offset_2)
crv = Curve(flatten(offset_2))
crv_phone_outline_3 = Curve(crv_phone_outline)
dom_2 = ConstructDomain(DomainStart=division_2, DomainEnd=neg_4)
dom_3 = ConstructDomain(DomainStart=division_3, DomainEnd=neg_5)
num_x_2_0 = Number(expr("x*2.0", num_phone_fit_tolerance_3))
offset_3 = OffsetCurve(Curve=crv_phone_outline_3, Distance=num_phone_fit_tolerance_3, Corners=1)  # -> flatten(Curve)
Z_3 = UnitZ(Factor=num_phone_fit_tolerance_3)
extr = Extrude(Base=srf_phone_lens_outline_surface, Direction=Z_2)
boundary_2 = BoundarySurfaces(Edges=offset_3)
pln_phone_lens_origin_5 = Plane(pln_phone_lens_origin_2)
brep_phone_lens = Brep(extr)
addition = Addition(A=num_phone_thickness_3, B=num_x_2_0)
rectangle = Rectangle(Plane=pln_phone_lens_origin_4, XSize=dom_2, YSize=dom_3, Radius=0)  # -> Rectangle, Length
srf_tolerance_phone_outline_surface = Surface(boundary_2)
rev = Reverse(Vector=Z_3)
extr_2 = ExtrudePoint(Base=rectangle.Rectangle, Point=pln_phone_lens_origin_3)
# notes: this creates a surface from the curve.  the input curve becomes the surface edge.
boundary_3 = BoundarySurfaces(Edges=crv_phone_outline)
Z_4 = UnitZ(Factor=addition)
cap = CapHoles(Brep=extr_2)
srf_phone_outline_surface = Surface(boundary_3)
brep_phone_field_of_view_cone = Brep(cap)
move_3 = Move(Geometry=srf_tolerance_phone_outline_surface, Motion=rev)  # -> Geometry, Transform
Z_5 = UnitZ(Factor=num_phone_thickness_3)
extr_3 = Extrude(Base=move_3.Geometry, Direction=Z_4)
extr_4 = Extrude(Base=srf_phone_outline_surface, Direction=Z_5)
vec = Vector(Z_5)
move_4 = Move(Geometry=crv, Motion=vec)  # -> Geometry, Transform
crv_phone_screen = Curve(move_4.Geometry)
num_screen_projection_inset_3 = Number(num_screen_projection_inset_2)
num_projection_distance_3 = Number(num_projection_distance_2)
num_projection_offset_3 = Number(num_projection_offset_2)
cluster_2 = Cluster_2(
    crv_phone_screen=crv_phone_screen,
    num_screen_inset=num_screen_projection_inset_3,
    num_projection_distance=num_projection_distance_3,
    num_projection_offset=num_projection_offset_3)
brep_phone = Brep(extr_4)
brep_phone_field_of_view_cone_2 = Brep(brep_phone_field_of_view_cone)
brep_screen_viewing_volume = Brep(cluster_2)
srf_phone_outline_surface_2 = Surface(boundary_3)
brep_tolerance_phone = Brep(extr_3)
pln_phone_lens_origin_6 = Plane(pln_phone_lens_origin_5)
crv_phone_outline_4 = Curve(phone_rectangle.Rectangle)
crv_phone_screen_2 = Curve(move_4.Geometry)
pln_phone_origin_3 = Plane(xy)
brep_phone_lens_2 = Brep(brep_phone_lens)
brep_phone_2 = Brep(brep_phone)
pln_phone_location_on_table_3 = Plane(pln_phone_location_on_table_2)
merge_phone_components = Merge(
    Data1=pln_phone_origin_3,
    Data2=crv_phone_outline_4,
    Data3=srf_phone_outline_surface_2,
    Data4=brep_phone_2,
    Data5=brep_phone_lens_2,
    Data6=pln_phone_lens_origin_6,
    Data7=brep_phone_field_of_view_cone_2,
    Data8=crv_phone_screen_2,
    Data9=brep_tolerance_phone,
    Data10=brep_screen_viewing_volume)
num_phone_table_offset_3 = Number(num_phone_table_offset_2)
pln_phone_location_on_table_4 = Plane(pln_phone_location_on_table_3)

# ----
# notes: adjust phone location relative to table
phone_table_offset = Slider(16, range=-50..50)
num_phone_table_offset_4 = Number(num_phone_table_offset_3)
num_phone_table_offset_5 = Number(num_phone_table_offset_4)
Z_6 = UnitZ(Factor=num_phone_table_offset_5)
move_5 = Move(Geometry=pln_phone_location_on_table_4, Motion=Z_6)  # -> Geometry, Transform

pln_phone_location_above_table = Plane(move_5.Geometry)
pln_phone_location_on_table_5 = Plane(pln_phone_location_on_table_4)
vec2pt = Vector2Pt(PointA=pln_phone_location_on_table_5, PointB=pln_phone_location_above_table, Unitize=False)  # -> Vector, Length
vdis = VectorDisplay(Anchor=pln_phone_location_on_table_5, Vector=vec2pt.Vector)
num_phone_viewing_angle_3 = Number(num_phone_viewing_angle_2)
pln_phone_location_on_table_6 = Plane(pln_phone_location_on_table_2)
pln_phone_location_above_table_2 = Plane(pln_phone_location_above_table)
pln_phone_location_above_table_3 = ClusterOutput(pln_phone_location_above_table_2)
pln_phone_location_on_table_7 = ClusterOutput(pln_phone_location_on_table_6)

# ----
# notes: set the viewing orientation, "portrait/landscape"
geo_phone_components = Geometry(merge_phone_components)
portrait_landscape = ValueList({"portrait 0": "0", "landscape 90": "90", "portrait 180": "180", "landscape 270": "270"}, selected="landscape 90")
num_phone_viewing_orientation_3 = Number(num_phone_viewing_orientation_2)
item = ListItem(List=geo_phone_components, Index="0", Wrap=True)
item_2 = ListItem(List=geo_phone_components, Index="2", Wrap=True)
srf_phone_outline_surface_3 = Surface(item_2)
pln_phone_origin_4 = Plane(item)
area = Area(Geometry=srf_phone_outline_surface_3)  # -> Area, Centroid
pl_origin = PlaneOrigin(Base=pln_phone_origin_4, Origin=area.Centroid)

num_phone_viewing_orientation_4 = Number(num_phone_viewing_orientation_3)

rotate = Rotate(Geometry=geo_phone_components, Angle=degrees(num_phone_viewing_orientation_4), Plane=pl_origin)  # -> Geometry, Transform
geo_phone_components_2 = Geometry(rotate.Geometry)

# ----
# notes: move phone location based on orientation
pln_phone_location_above_table_4 = Plane(pln_phone_location_above_table)
geo_phone_components_3 = Geometry(geo_phone_components_2)
item_3 = ListItem(List=geo_phone_components_3, Index="0", Wrap=True)
pln_phone_origin_5 = Plane(item_3)
vec2pt_2 = Vector2Pt(PointA=pln_phone_origin_5, PointB=pln_phone_location_above_table_4, Unitize=False)  # -> Vector, Length
geo_phone_components_4 = Geometry(geo_phone_components_3)
item_4 = ListItem(List=geo_phone_components_4, Index="1", Wrap=True)
crv_phone_outline_5 = Curve(item_4)
crv_cp = CurveClosestPoint(Point=pln_phone_location_above_table_4, Curve=crv_phone_outline_5)  # -> Point, Parameter, Distance
vec2pt_3 = Vector2Pt(PointA=crv_cp.Point, PointB=pln_phone_location_above_table_4, Unitize=False)  # -> Vector, Length
move_6 = Move(Geometry=geo_phone_components_4, Motion=vec2pt_3.Vector)  # -> Geometry, Transform
vdis_2 = VectorDisplay(Anchor=crv_cp.Point, Vector=vec2pt_3.Vector)
geo_phone_components_5 = Geometry(move_6.Geometry)

# ----
# notes: rotate the phone to viewing position
geo_phone_components_6 = Geometry(geo_phone_components_5)
num_zero = Number(0)
item_5 = ListItem(List=geo_phone_components_6, Index="0", Wrap=True)
num_phone_viewing_direction = Number(num_zero)
pln_phone_origin_6 = Plane(item_5)
rotate_2 = Rotate(Geometry=geo_phone_components_6, Angle=degrees(num_phone_viewing_direction), Plane=pln_phone_origin_6)  # -> Geometry, Transform
geo_phone_components_7 = Geometry(rotate_2.Geometry)

pln_phone_location_above_table_5 = Plane(pln_phone_location_above_table_4)

# ----
# notes: rotate the phone to viewing position "up/down"
geo_phone_components_8 = Geometry(geo_phone_components_7)
phone_viewing_angle = Slider(72, range=0..360)
deplane = DeconstructPlane(Plane=pln_phone_location_above_table_5)  # -> Origin, XAxis, YAxis, ZAxis
num_phone_viewing_angle_4 = Number(num_phone_viewing_angle_3)
line = LineSDL(Start=deplane.Origin, Direction=deplane.XAxis, Length=1)
rotax = RotateAxis(Geometry=geo_phone_components_8, Angle=degrees(num_phone_viewing_angle_4), Axis=line)  # -> Geometry, Transform
geo_phone_components_9 = Geometry(rotax.Geometry)

geo_phone_components_10 = Geometry(geo_phone_components_9)
geo_phone_components_11 = Geometry(geo_phone_components_10)
geo_phone_components_12 = Geometry(geo_phone_components_11)
item_6 = ListItem(List=geo_phone_components_12, Index="0", Wrap=True)
item_7 = ListItem(List=geo_phone_components_12, Index="2", Wrap=True)
item_8 = ListItem(List=geo_phone_components_12, Index="3", Wrap=True)
item_9 = ListItem(List=geo_phone_components_12, Index="4", Wrap=True)
item_10 = ListItem(List=geo_phone_components_12, Index="6", Wrap=True)
item_11 = ListItem(List=geo_phone_components_12, Index="7", Wrap=True)
item_12 = ListItem(List=geo_phone_components_12, Index="8", Wrap=True)
item_13 = ListItem(List=geo_phone_components_12, Index="9", Wrap=True)
srf_phone_outline_surface_4 = Surface(item_7)
brep_phone_3 = Brep(item_8)
brep_phone_lens_3 = Brep(item_9)
pln_phone_origin_7 = Plane(item_6)
crv_phone_screen_3 = Curve(item_11)
brep_tolerance_phone_2 = Brep(item_12)
brep_screen_viewing_volume_2 = Brep(item_13)
brep_phone_field_of_view_cone_3 = Brep(item_10)
merge_2 = Merge(Data1=brep_tolerance_phone_2, Data2=brep_screen_viewing_volume_2)
volume = Volume(Geometry=brep_phone_3)  # -> Volume, Centroid
pt_phone_centroid = Point(volume.Centroid)
num_phone_volume = Number(volume.Volume)
sunion = SolidUnion(Breps=merge_2)
fmerge = MergeFaces(Brep=sunion)  # -> Breps, Before, After
project = Project(Geometry=pt_phone_centroid, Plane=pln_phone_location_on_table_6)  # -> Geometry, Transform
brep_phone_void = Brep(fmerge.Breps)
ln = Line(StartPoint=pt_phone_centroid, EndPoint=project.Geometry)
line_phone_center_of_gravity = Line(ln)
line_phone_center_of_gravity_2 = ClusterOutput(line_phone_center_of_gravity)
pln_phone_origin_8 = ClusterOutput(pln_phone_origin_7)
srf_phone_outline_surface_5 = ClusterOutput(srf_phone_outline_surface_4)
brep_phone_4 = ClusterOutput(brep_phone_3)
num_phone_volume_2 = ClusterOutput(num_phone_volume)
pt_phone_centroid_2 = ClusterOutput(pt_phone_centroid)
brep_phone_lens_4 = ClusterOutput(brep_phone_lens_3)
crv_phone_screen_4 = ClusterOutput(crv_phone_screen_3)
brep_tolerance_phone_3 = ClusterOutput(brep_tolerance_phone_2)
brep_screen_viewing_volume_3 = ClusterOutput(brep_screen_viewing_volume_2)
brep_phone_field_of_view_cone_4 = ClusterOutput(brep_phone_field_of_view_cone_3)
brep_phone_void_2 = ClusterOutput(brep_phone_void)

# ==== cluster ColorByVolume
num_min_volume = ClusterInput()
num_max_volume = ClusterInput()
brep = ClusterInput()
brep_2 = Brep(brep)
num_min_volume_2 = Number(num_min_volume)
num_max_volume_2 = Number(num_max_volume)
volume = Volume(Geometry=brep_2)  # -> Volume, Centroid
brep_volume = Number(volume.Volume)
num_volume_limit = Number(num_max_volume_2)
larger = LargerThan(FirstNumber=brep_volume, SecondNumber=num_max_volume_2)  # -> LargerThan, OrEqualTo
gradient = Gradient(
    LowerLimit=num_min_volume_2,
    UpperLimit=num_max_volume_2,
    Parameter=brep_volume,
    stops=[0: RGB(0, 128, 0), 0.5: RGB(255, 255, 0), 1: RGB(204, 0, 0)])
not = GateNot(A=larger.OrEqualTo)
bool_meetsvolumelimit = Boolean(not)
num_volume_limit_2 = Number(num_volume_limit)
col_by_volume = Colour(gradient)
num_volume_limit_3 = ClusterOutput(num_volume_limit_2)
brep_3 = ClusterOutput(brep_2)
bool_meetsvolumelimit_2 = ClusterOutput(bool_meetsvolumelimit)
brep_volume_2 = ClusterOutput(brep_volume)
col_by_volume_2 = ClusterOutput(col_by_volume)

# ==== cluster CenterOfGravityTest
pln_cell_phone_stand_design_origin = ClusterInput()
brep_cell_phone_stand_design = ClusterInput()
pt_phone_centroid = ClusterInput()
pln_cell_phone_stand_design_origin_2 = Plane(pln_cell_phone_stand_design_origin)
brep_cell_phone_stand_design_2 = Brep(brep_cell_phone_stand_design)
pt_phone_centroid_2 = Point(pt_phone_centroid)
project = Project(Geometry=pt_phone_centroid_2, Plane=pln_cell_phone_stand_design_origin_2)  # -> Geometry, Transform
sec = BrepPlane(Brep=brep_cell_phone_stand_design_2, Plane=pln_cell_phone_stand_design_origin_2)  # -> Curves, Points
pt_center_of_gravity_on_table = Point(project.Geometry)
crv_base_on_table = Curve(sec.Curves)
null = NullItem(Item=sec.Curves)  # -> NullFlags, InvalidFlags, Description
incurve = PointInCurve(Point=pt_center_of_gravity_on_table, Curve=crv_base_on_table)  # -> Relationship, Point
panel = Panel(incurve.Relationship)
bool_stand_not_on_surface = Boolean(null.NullFlags)
equals = Equality(FirstNumber=incurve.Relationship, SecondNumber="2.0")  # -> Equality, Inequality
int = Integer(equals.Equality)
panel_2 = Panel(equals.Equality)
panel_3 = Panel(int)
ma = MassAddition(Input=int)  # -> Result, PartialResults
item = ListItem(List=bool_stand_not_on_surface, Index=0, Wrap=True)
larger = LargerThan(FirstNumber=ma.Result, SecondNumber="0")  # -> LargerThan, OrEqualTo
bool_center_of_gravity_stable = Boolean(larger.LargerThan)
panel_4 = Panel(larger.LargerThan)
eval = Evaluate(F="If(test,x,y)", x="Stand does not sit on the table.", y="Stand sits on the table.", test=item)
# Test for null, if the center of gravity is null then it is not stable.
c_script = CSharpScript(test=bool_center_of_gravity_stable)  # -> out, output
# ---------- c_script: C# ----------
// Grasshopper Script Instance
#region Usings
using System;
using System.Linq;
using System.Collections;
using System.Collections.Generic;
using System.Drawing;

using Rhino;
using Rhino.Geometry;

using Grasshopper;
using Grasshopper.Kernel;
using Grasshopper.Kernel.Data;
using Grasshopper.Kernel.Types;
#endregion

public class Script_Instance : GH_ScriptInstance
{
    #region Notes
    /* 
      Members:
        RhinoDoc RhinoDocument
        GH_Document GrasshopperDocument
        IGH_Component Component
        int Iteration

      Methods (Virtual & overridable):
        Print(string text)
        Print(string format, params object[] args)
        Reflect(object obj)
        Reflect(object obj, string method_name)
    */
    #endregion

    private void RunScript(object test, ref object output)
    {
        // Write your logic here
        if( test == null)
        { output = false;}
        else
        {
            output = test;
        }
    }
}
# ---------- end c_script ----------
bool_center_of_gravity_stable_2 = Boolean(c_script.output)
txt_output_messages = Text(flatten(eval))
txt_output_messages_2 = ClusterOutput(txt_output_messages)
bool_center_of_gravity_stable_3 = ClusterOutput(bool_center_of_gravity_stable_2)
bool_stand_not_on_surface_2 = ClusterOutput(bool_stand_not_on_surface)

# ==== cluster ClusterVisualizeAnalysis
# notes: Let us analyze the stand for stability.
pln_cell_phone_stand_design_origin = ClusterInput()
col_by_volume_and_stability = ClusterInput()
brep_cell_phone_stand_design = ClusterInput()
bool_meetsvolumelimit = ClusterInput()
num_stand_volume = ClusterInput()
num_volume_limit = ClusterInput()
brep_tolerance_phone = ClusterInput()
pt_phone_centroid = ClusterInput()
num_stand_volume_2 = Number(num_stand_volume)
pln_cell_phone_stand_design_origin_2 = Plane(pln_cell_phone_stand_design_origin)
brep_cell_phone_stand_design_2 = Brep(brep_cell_phone_stand_design)
brep_tolerance_phone_2 = Brep(brep_tolerance_phone)
pt_phone_centroid_2 = Point(pt_phone_centroid)
# notes: Let us find the section through the bottom of the stand to use for the stability test between the stand and the surface it sits on.
sec = BrepPlane(Brep=brep_cell_phone_stand_design_2, Plane=pln_cell_phone_stand_design_origin_2)  # -> Curves, Points
boundary = BoundarySurfaces(Edges=sec.Curves)
# notes: sometimes the surface normal of the resulting boundary is pointed in the wrong direction, let us test and fix if necessary.
cluster = Cluster_6(srf_base=boundary)
brep_cell_phone_stand_design_3 = Brep(brep_cell_phone_stand_design_2)
pt_phone_centroid_3 = Point(pt_phone_centroid_2)
srf_stand_design_bottom = Surface(cluster)
pln_cell_phone_stand_design_origin_3 = Plane(pln_cell_phone_stand_design_origin_2)
pt_top_centroid = Point(pt_phone_centroid_3)
brep_bottom = Brep(srf_stand_design_bottom)
# notes: We are assuming the weight of the base is negligible relative to the weight of the phone, otherwise we would need to modify the center of gravity as we move down the object combingin the center of gravity of the phone with the center of gravity of the base to have a new center of gravity for the assembly.
pln_bottom = Plane(pln_cell_phone_stand_design_origin_3)
brep_top = Brep(brep_cell_phone_stand_design_3)
# notes: let us test the stablity of the phone in the stand.
# notes: Our base assumptions will be that if the center of gravity of the phone is above the supporting area of the stand AND the center of gravity is above the base of the stand, then it is stable.
# notes: A better test than the intersection of the brep and the base plane is to use a convex hull of the collection of shapes.  Imagine a tripod, there is no intersection curve for the center of the tripod yet a center of gravity coincident with the center of the tripod would be stable. Here, we create point samples along all the curves to generate a set of points from which a convex hull is calculated.
# notes: test phone and stand
cluster_2 = Cluster_5(
    brep_top=brep_tolerance_phone_2,
    pt_top_centroid=pt_phone_centroid_2,
    brep_bottom=brep_cell_phone_stand_design_2,
    pln_bottom=pln_cell_phone_stand_design_origin_2)  # -> bool_breps_intersect_2, pln_bottom_8, pt_top_centroid_7, brep_top_5, brep_bottom_5, srf_top_planar_faces_4, srf_bottom_planar_faces_5, srf_common_faces_2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
# notes: test stand and surface it sits on.
cluster_3 = Cluster_7(brep_top=brep_top, pt_top_centroid=pt_top_centroid, brep_bottom=brep_bottom, pln_bottom=pln_bottom)  # -> bool_breps_intersect_2, pln_bottom_8, pt_top_centroid_7, brep_top_5, brep_bottom_5, srf_top_planar_faces_4, srf_bottom_planar_faces_5, srf_common_faces_2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
panel = Panel(cluster_2.R)
crv_common_surfaces_projected_convex_hul = Curve(cluster_2.crv_common_surfaces_projected_convex_hul_2)  # "Crv common surfaces projected convex hull"
bool_breps_intersect = Boolean(cluster_2.bool_breps_intersect_2)
brep_cell_phone_stand_design_4 = Brep(cluster_2.brep_bottom_5)
pt_phone_centroid_projected = Point(cluster_2.pt_top_centroid_projected_2)
pln_design_origin = Plane(cluster_2.pln_bottom_8)
pt_closest_point_to_hull = Point(cluster_2.pt_closest_point_to_hull_2)
srf_common_surface_phone = Surface(cluster_2.srf_common_faces_2)
bool_phone_stable = Boolean(cluster_2.R)
pt = Point(cluster_3.pt_closest_point_to_hull_2)
panel_2 = Panel(cluster_3.R)
srf_common_surface_base = Surface(cluster_3.srf_common_faces_2)
num_projected_surface_area_stand_to_surf = Number(cluster_3.num_projected_surface_area_3)  # "Num projected surface area stand to surface"
bool_basestable = Boolean(cluster_3.R)
brep_cell_phone_stand_design_5 = Brep(brep_cell_phone_stand_design_4)
srf_common_surface_phone_2 = Surface(srf_common_surface_phone)
col_by_volume_and_stability_2 = Colour(col_by_volume_and_stability)
srf_common_surface_base_2 = Surface(srf_common_surface_base)
bool_meetsvolumelimit_2 = Boolean(bool_meetsvolumelimit)
bool_breps_intersect_2 = Boolean(bool_breps_intersect)
num_stand_volume_3 = Number(num_stand_volume_2)
bool_phone_stable_2 = Boolean(bool_phone_stable)
num_volume_limit_2 = Number(num_volume_limit)
pln_design_origin_2 = Plane(pln_design_origin)
bool_basestable_2 = Boolean(bool_basestable)
# notes: Here we have a custom preview which will 'render' the object with a color that corresponds to target print volumes, and shares messages about the design.
cluster_display = ClusterDisplay(
    col_stable=col_by_volume_and_stability_2,
    bool_breps_intersect=bool_breps_intersect_2,
    brep_cell_phone_stand_design=brep_cell_phone_stand_design_5,
    srf_common_surface_phone=srf_common_surface_phone_2,
    srf_common_surface_base=srf_common_surface_base_2,
    bool_phone_stable=bool_phone_stable_2,
    bool_basestable=bool_basestable_2,
    bool_meetsvolumelimit=bool_meetsvolumelimit_2,
    num_stand_volume=num_stand_volume_3,
    num_volume_limit=num_volume_limit_2,
    pln_design_origin=pln_design_origin_2)
cluster_visualize_support_projection = ClusterVisualizeSupportProjection(
    pt_phone_centroid_projected=pt_phone_centroid_projected,
    pt_closest_point_to_hull=pt_closest_point_to_hull,
    crv_common_surfaces_projected_convex_hul=crv_common_surfaces_projected_convex_hul)
bool_design_isstable = ClusterOutput(cluster_display)

# ==== cluster Cluster
num_camera35mmlenslength = ClusterInput()
# notes: these values were determined empirically. this equation may require adjestment depending on your setup.
num_camera35mmlenslength_2 = Number(num_camera35mmlenslength)
num = Number("2/30")
num_2 = Number("40")
multiplication = Multiplication(A=num_2, B=num)
division = Division(A=multiplication, B=num_camera35mmlenslength_2)
panel = Panel(division)
panel_2 = Panel(multiplication)
num_fov = Number(division)
num_fov_2 = ClusterOutput(num_fov)

# ==== cluster Cluster_2
num_projection_distance = ClusterInput()
num_projection_offset = ClusterInput()
crv_phone_screen = ClusterInput()
num_screen_inset = ClusterInput()
num_projection_distance_2 = Number(num_projection_distance)
num_projection_offset_2 = Number(num_projection_offset)
crv_phone_screen_2 = Curve(crv_phone_screen)
num_screen_inset_2 = Number(num_screen_inset)
offset = OffsetCurve(Curve=crv_phone_screen_2, Distance=Slider(0, range=0..10), Corners=3)  # -> flatten(Curve)
crv_phone_screen_3 = Curve(offset)
boundary = BoundarySurfaces(Edges=crv_phone_screen_3)
area = Area(Geometry=boundary)  # -> Area, Centroid
srf_cp = SurfaceClosestPoint(Point=area.Centroid, Surface=boundary)  # -> Point, UVPoint, Distance
evalsrf = EvaluateSurface(Surface=boundary, Point=srf_cp.UVPoint)  # -> Point, Normal, UDirection, VDirection, Frame
num_projection_distance_3 = Number(num_projection_distance_2)
num_projection_offset_3 = Number(num_projection_offset_2)
num_screen_inset_3 = Number(num_screen_inset_2)
vec = Vector(evalsrf.Normal)
crv_phone_screen_4 = Curve(crv_phone_screen_3)
amp = Amplitude(Vector=vec, Amplitude=num_screen_inset_3)
amp_2 = Amplitude(Vector=vec, Amplitude=num_projection_distance_3)
move = Move(Geometry=crv_phone_screen_4, Motion=amp)  # -> Geometry, Transform
move_2 = Move(Geometry=move.Geometry, Motion=amp_2)  # -> Geometry, Transform
offset_2 = OffsetCurve(Curve=move_2.Geometry, Distance=num_projection_offset_3, Corners=1)  # -> flatten(Curve)
rulesrf = RuledSurface(CurveA=crv_phone_screen_4, CurveB=move.Geometry)
rulesrf_2 = RuledSurface(CurveA=move.Geometry, CurveB=offset_2)
cap = CapHoles(Brep=rulesrf)
cap_2 = CapHoles(Brep=rulesrf_2)
merge = Merge(Data1=cap, Data2=cap_2)
sunion = SolidUnion(Breps=merge)
brep_screen_viewing_volume = Brep(sunion)
brep_screen_viewing_volume_2 = ClusterOutput(brep_screen_viewing_volume)

# ==== cluster Cluster_5
pt_top_centroid = ClusterInput()
brep_bottom = ClusterInput()
pln_bottom = ClusterInput()
# notes: We need to identify the area of the interface between the phone and the stand, project that to a plane, and then calculate the convex hull of that projection.
# notes: Let us take as inputs the 2 objects, phone and stand.
brep_top = ClusterInput()
brep_top_2 = Brep(brep_top)
pt_top_centroid_2 = Point(pt_top_centroid)
brep_bottom_2 = Brep(brep_bottom)
pln_bottom_2 = Plane(pln_bottom)
debrep = DeconstructBrep(Brep=brep_top_2)  # -> Faces, Edges, Vertices
debrep_2 = DeconstructBrep(Brep=brep_bottom_2)  # -> Faces, Edges, Vertices
srf_bottom_faces = Surface(debrep_2.Faces)
srf_top_faces = Surface(debrep.Faces)
# notes: to simplify the calculation we will only look at the planar faces of the 2 objects, as we assume the phone is mostly flat.
cluster_find_planar_faces = ClusterFindPlanarFaces(srf_design_faces=srf_top_faces)
cluster_find_planar_faces_2 = ClusterFindPlanarFaces(srf_design_faces=srf_bottom_faces)
pt_top_centroid_3 = Point(pt_top_centroid_2)
srf_bottom_planar_faces = Surface(cluster_find_planar_faces_2)
# notes: lets test that there is an intersection between the 2 breps
srf_top_planar_faces = Surface(cluster_find_planar_faces)
srf_bottom_planar_faces_2 = Surface(srf_bottom_planar_faces)
panel = Panel(srf_top_planar_faces)
panel_2 = Panel(srf_bottom_planar_faces_2)
srf_top_planar_faces_2 = Surface(srf_top_planar_faces)
# notes: To simplify the calculation we will only consider the dynamic compressive loading of the phone.
srf_bottom_planar_faces_3 = Surface(srf_bottom_planar_faces)
# notes: it is often useful to include the input and other byproducts available as output.
brep_top_3 = Brep(brep_top_2)
brep_bottom_3 = Brep(brep_bottom_2)
# notes: Let us identify which faces are facing 'up' and which faces are facing 'down'.  We compare the surface normal of the face to the direction of gravity, 'down'.
cluster = Cluster_3(srf_planar_faces=srf_top_planar_faces)  # -> srf_planar_faces_up_2, bool_output_equality_2, srf_planar_faces_down_2
cluster_2 = Cluster_3(srf_planar_faces=srf_bottom_planar_faces_2)  # -> srf_planar_faces_up_2, bool_output_equality_2, srf_planar_faces_down_2
srf_phone_planar_faces_down = Surface(cluster.srf_planar_faces_down_2)
srf_design_planar_faces_up = Surface(cluster_2.srf_planar_faces_up_2)
srf_phone_planar_faces_down_2 = Surface(srf_phone_planar_faces_down)
srf_design_planar_faces_up_2 = Surface(srf_design_planar_faces_up)
area = Area(Geometry=srf_design_planar_faces_up_2)  # -> Area, Centroid
# notes: make sure the point is on the surface
srf_cp = SurfaceClosestPoint(Point=area.Centroid, Surface=srf_design_planar_faces_up_2)  # -> Point, UVPoint, Distance
pt = Point(srf_cp.Point)
# notes: find the closest point in phone faces to the centroid of design faces.
# notes: result: closest points per phone surface
srf_phone_planar_faces_down_3 = Surface(graft(srf_phone_planar_faces_down_2))
srf_cp_2 = SurfaceClosestPoint(Point=pt, Surface=srf_phone_planar_faces_down_3)  # -> Point, UVPoint, Distance
pln_bottom_3 = Plane(pln_bottom_2)
# notes: if the distance is zero, the point in in the plane.
panel_3 = Panel("0.0")
num = Number(panel_3)
epsilon_equality = GhPythonScript(a=srf_cp_2.Distance, b=num)  # -> out, result
# ---------- epsilon_equality: Python ----------
__author__ = "tj"
__version__ = "2023.09.03"

import rhinoscriptsyntax as rs

epsilon = 1e-10  # Choose an appropriate epsilon value

if a is None:
    print("a is None")
elif abs(a - b) < epsilon:
    print("a and b are close enough to being equal")
    result = True
else:
    print("a and b are not equal")
    result = False
# ---------- end epsilon_equality ----------
panel_4 = Panel(epsilon_equality.result)
# notes: filter streams by the boolean 'point is in plane'
srf_design_planar_faces_up_3 = Surface(srf_design_planar_faces_up_2)
pt_closest_uv = Point(srf_cp_2.UVPoint)
pt_closest = Point(srf_cp_2.Point)
dispatch = Dispatch(List=pt_closest, DispatchPattern=epsilon_equality.result)  # -> ListA, ListB
dispatch_2 = Dispatch(List=pt_closest_uv, DispatchPattern=epsilon_equality.result)  # -> ListA, ListB
dispatch_3 = Dispatch(List=srf_design_planar_faces_up_3, DispatchPattern=epsilon_equality.result)  # -> ListA, ListB
# notes: these surfaces are common to both the phone and the stand, thus weight is transfered through these surfaces.
srf_common_faces_up = Surface(dispatch_3.ListA)
panel_5 = Panel(srf_common_faces_up)
panel_6 = Panel(dispatch.ListA)
panel_7 = Panel(dispatch_2.ListA)
srf_common_faces_up_2 = Surface(flatten(srf_common_faces_up))
pt_top_centroid_4 = Point(pt_top_centroid_3)
pln_bottom_4 = Plane(pln_bottom_3)
python = GhPythonScript(inputVar=srf_common_faces_up_2)  # -> out, result
# ---------- python: Python ----------
__author__ = "tj"
__version__ = "2023.09.07"

import rhinoscriptsyntax as rs

# Check if the inputVar is None
if inputVar is None:
    result = False
else:
    result = True
# ---------- end python ----------
ma = MassAddition(Input=python.result)  # -> Result, PartialResults
larger = LargerThan(FirstNumber=ma.Result, SecondNumber=0)  # -> LargerThan, OrEqualTo
# notes: to test stability of this interface, we will test that the centroid of the phone is inside the convex hull of the common surfaces.
bool_hasintersection = Boolean(larger.LargerThan)
# notes: we will use the input plane as the projection plane for the centroid and the common surfaces.
pln_bottom_5 = Plane(pln_bottom_4)
pln_bottom_6 = Plane(pln_bottom_5)
project = Project(Geometry=srf_common_faces_up_2, Plane=pln_bottom_6)  # -> Geometry, Transform
srf_projected_common_faces = Surface(project.Geometry)
cluster_sample_curves = ClusterSampleCurves(srf_planar_faces=srf_projected_common_faces)
# notes: this is the area of the projected surfaces. a kind of approximation of the bearing surfaces for the phone.
area_2 = Area(Geometry=srf_projected_common_faces)  # -> Area, Centroid
pt_top_centroid_5 = Point(pt_top_centroid_4)
ma_2 = MassAddition(Input=area_2.Area)  # -> Result, PartialResults
num_projected_surface_area = Number(ma_2.Result)
cluster_3 = Cluster_4(pt_hull_points=cluster_sample_curves, pl_hull_plane=pln_bottom_6, pt_test_point=pt_top_centroid_5)  # -> pt_test_point_projected_2, pt_closest_point_to_hull_2, num_point_to_hull_distance_2, crv_hull_2, int_result_2, bool_point_in_hull_2
bool_hasintersection_2 = Boolean(bool_hasintersection)
format = Format(Format="{0:0.00}", Culture=127, Data0=ma_2.Result)
concat = Concatenate(FragmentA=format, FragmentB="mm²")
bool_hasintersection_3 = Boolean(bool_hasintersection_2)
int_result_of_point_in_hull = Integer(cluster_3.int_result_2)
bool_hasintersection_4 = Boolean(bool_hasintersection_3)
panel_8 = Panel(concat)
and = GateAnd(A=cluster_3.bool_point_in_hull_2, B=bool_hasintersection_4)
crv_common_surfaces_projected_convex_hul = Curve(cluster_3.crv_hull_2)  # "Crv common surfaces projected convex hull"
panel_9 = Panel(int_result_of_point_in_hull)
panel_10 = Panel(cluster_3.bool_point_in_hull_2)
srf_projected_common_faces_2 = Surface(srf_projected_common_faces)
num_projected_surface_area_2 = Number(num_projected_surface_area)
pt_top_centroid_projected = Point(cluster_3.pt_test_point_projected_2)
num_point_to_hull_distance = Number(cluster_3.num_point_to_hull_distance_2)
txt_projected_surface_area = Text(panel_8)
pt_closest_point_to_hull = Point(cluster_3.pt_closest_point_to_hull_2)
srf_bottom_planar_faces_4 = Surface(srf_bottom_planar_faces_3)
srf_common_faces = Surface(srf_common_faces_up_2)
srf_top_planar_faces_3 = Surface(srf_top_planar_faces_2)
bool_breps_intersect = Boolean(bool_hasintersection_3)
pt_top_centroid_6 = Point(pt_top_centroid_4)
brep_bottom_4 = Brep(brep_bottom_3)
pln_bottom_7 = Plane(pln_bottom_4)
brep_top_4 = Brep(brep_top_3)
srf_common_faces_2 = ClusterOutput(srf_common_faces)
pt_top_centroid_projected_2 = ClusterOutput(pt_top_centroid_projected)
pt_closest_point_to_hull_2 = ClusterOutput(pt_closest_point_to_hull)
num_point_to_hull_distance_2 = ClusterOutput(num_point_to_hull_distance)
num_projected_surface_area_3 = ClusterOutput(num_projected_surface_area_2)
srf_projected_common_faces_3 = ClusterOutput(srf_projected_common_faces_2)
txt_projected_surface_area_2 = ClusterOutput(txt_projected_surface_area)
crv_common_surfaces_projected_convex_hul_2 = ClusterOutput(crv_common_surfaces_projected_convex_hul)  # "Crv common surfaces projected convex hull"
int_result_of_point_in_hull_2 = ClusterOutput(int_result_of_point_in_hull)
R = ClusterOutput(and)
pln_bottom_8 = ClusterOutput(pln_bottom_7)
pt_top_centroid_7 = ClusterOutput(pt_top_centroid_6)
brep_top_5 = ClusterOutput(brep_top_4)
brep_bottom_5 = ClusterOutput(brep_bottom_4)
srf_top_planar_faces_4 = ClusterOutput(srf_top_planar_faces_3)
srf_bottom_planar_faces_5 = ClusterOutput(srf_bottom_planar_faces_4)
bool_breps_intersect_2 = ClusterOutput(bool_breps_intersect)

# ==== cluster Cluster_6
srf_base = ClusterInput()
srf_base_2 = Surface(srf_base)
area = Area(Geometry=srf_base_2)  # -> Area, Centroid
srf_cp = SurfaceClosestPoint(Point=area.Centroid, Surface=srf_base_2)  # -> Point, UVPoint, Distance
evalsrf = EvaluateSurface(Surface=srf_base_2, Point=srf_cp.UVPoint)  # -> Point, Normal, UDirection, VDirection, Frame
unit = UnitVector(Vector=evalsrf.Normal)
Z = UnitZ(Factor=1)
subtraction = Subtraction(A=Z, B=unit)
num_zero = Number(0)
vlen = VectorLength(Vector=subtraction)
flip = Flip(Surface=srf_base_2)  # -> Surface, Result
epsilon_equality = GhPythonScript(a=vlen, b=num_zero)  # -> out, result; same code as epsilon_equality
filter = StreamFilter(Gate=epsilon_equality.result, Stream0=flip.Surface, Stream1=srf_base_2)
srf_base_3 = Surface(filter)
srf_base_4 = ClusterOutput(srf_base_3)

# ==== cluster ClusterDisplay
num_stand_volume = ClusterInput()
num_volume_limit = ClusterInput()
bool_meetsvolumelimit = ClusterInput()
brep_cell_phone_stand_design = ClusterInput()
srf_common_surface_phone = ClusterInput()
srf_common_surface_base = ClusterInput()
bool_phone_stable = ClusterInput()
bool_basestable = ClusterInput()
bool_breps_intersect = ClusterInput()
pln_design_origin = ClusterInput()
col_stable = ClusterInput()
col_stable_2 = Colour(col_stable)
srf_common_surface_base_2 = Surface(srf_common_surface_base)
bool_basestable_2 = Boolean(bool_basestable)
brep_cell_phone_stand_design_2 = Brep(brep_cell_phone_stand_design)
srf_common_surface_phone_2 = Surface(srf_common_surface_phone)
bool_phone_stable_2 = Boolean(bool_phone_stable)
bool_meetsvolumelimit_2 = Boolean(bool_meetsvolumelimit)
num_volume_limit_2 = Number(num_volume_limit)
pln_design_origin_2 = Plane(pln_design_origin)
bool_breps_intersect_2 = Boolean(bool_breps_intersect)
num_stand_volume_2 = Number(num_stand_volume)
stable = ColourSwatch(SwatchColor=RGB(133, 186, 255))
null = NullItem(Item=col_stable_2)  # -> NullFlags, InvalidFlags, Description
round = Round(Number=num_stand_volume_2)  # -> Nearest, Floor, Ceiling
eval = Evaluate(F="If(test, color01,color02)", test=null.NullFlags, color01=stable, color02=col_stable_2)
panel = Panel("Phone to Base interface unstable. Check the phone center of gravity relative to stand slot projection.")
cir = Circle(Plane=pln_design_origin_2, Radius="75")
col_stable_3 = Colour(eval)
and = GateAnd(A=bool_basestable_2, B=bool_meetsvolumelimit_2)
panel_2 = Panel("""Assembly is unstable.
The phone does not sit in the base.""")
bool_breps_intersect_3 = Boolean(bool_breps_intersect_2)
eval_2 = EvaluateCurve(Curve=cir, Parameter="0")  # -> Point, Tangent, Angle
and_2 = GateAnd(A=bool_phone_stable_2, B=and)
concat = Concatenate(FragmentA="Stand volume (", FragmentB=round.Nearest)
unstable = ColourSwatch(SwatchColor=RGB(168, 84, 84))
concat_2 = Concatenate(FragmentA=concat, FragmentB="mm³) exceeds limit: ")
concat_3 = Concatenate(FragmentA=concat_2, FragmentB=num_volume_limit_2)
bool_breps_intersect_4 = Boolean(bool_breps_intersect_2)
unstable_2 = ColourSwatch(SwatchColor=RGB(255, 0, 0))
material = CreateMaterial(Diffuse=unstable, Specular=RGB(255, 255, 255), Emission=RGB(0, 0, 0), Transparency=Slider(1, range=0..1), Shine=0)
and_3 = GateAnd(A=bool_phone_stable_2, B=bool_basestable_2)
concat_4 = Concatenate(FragmentA=concat_3, FragmentB="mm³")
unstable_3 = ColourSwatch(SwatchColor=RGB(255, 0, 0))
unstable_4 = ColourSwatch(SwatchColor=RGB(255, 0, 0))
filter = StreamFilter(Gate=bool_breps_intersect_4, Stream0=unstable_2, Stream1=material)
col_stable_4 = Colour(col_stable_3)
filter_2 = StreamFilter(Gate=bool_meetsvolumelimit_2, Stream0=concat_4)
filter_3 = StreamFilter(Gate=bool_basestable_2, Stream0="Base to Sitting Surface interface unstable.")
filter_4 = StreamFilter(Gate=bool_phone_stable_2, Stream0=panel)
filter_5 = StreamFilter(Gate=and_2, Stream0="Assembly is not good. ", Stream1="Assembly is good.")
filter_6 = StreamFilter(Gate=bool_phone_stable_2, Stream0=unstable_3)
filter_7 = StreamFilter(Gate=and_3, Stream0=filter, Stream1=col_stable_4)
filter_8 = StreamFilter(Gate=bool_basestable_2, Stream0=unstable_4)
concat_5 = Concatenate(FragmentA=filter_5, FragmentB=filter_4)
concat_6 = Concatenate(FragmentA=concat_5, FragmentB=filter_3)
concat_7 = Concatenate(FragmentA=concat_6, FragmentB=filter_2)
filter_9 = StreamFilter(Gate=bool_breps_intersect_3, Stream0=panel_2, Stream1=concat_7)
and_4 = GateAnd(A=bool_breps_intersect_3, B=and_2)
preview = CustomPreview(Geometry=brep_cell_phone_stand_design_2, Material=filter_7)
preview_2 = CustomPreview(Geometry=srf_common_surface_phone_2, Material=filter_6)
preview_3 = CustomPreview(Geometry=srf_common_surface_base_2, Material=filter_8)
txt_result = Text(filter_9)
bool_design_isstable = Boolean(and_4)
pt_label = Point(eval_2.Point)
bool_design_isstable_2 = ClusterOutput(bool_design_isstable)
filter_10 = StreamFilter(Gate=and_2, Stream0=ColourSwatch(SwatchColor=RGB(255, 0, 0)), Stream1=ColourSwatch(SwatchColor=RGB(0, 0, 0)))
tag = TextTag3D(Location=pt_label, Text=txt_result, Size="8", Colour=filter_10, Justification=4)

# ==== cluster Cluster_7
# notes: We need to identify the area of the interface between the phone and the stand, project that to a plane, and then calculate the convex hull of that projection.
# notes: Let us take as inputs the 2 objects, phone and stand.
brep_top = ClusterInput()
pt_top_centroid = ClusterInput()
brep_bottom = ClusterInput()
pln_bottom = ClusterInput()
brep_top_2 = Brep(brep_top)
pt_top_centroid_2 = Point(pt_top_centroid)
brep_bottom_2 = Brep(brep_bottom)
pln_bottom_2 = Plane(pln_bottom)
debrep = DeconstructBrep(Brep=brep_top_2)  # -> Faces, Edges, Vertices
debrep_2 = DeconstructBrep(Brep=brep_bottom_2)  # -> Faces, Edges, Vertices
srf_bottom_faces = Surface(debrep_2.Faces)
srf_top_faces = Surface(debrep.Faces)
# notes: to simplify the calculation we will only look at the planar faces of the 2 objects, as we assume the phone is mostly flat.
cluster_find_planar_faces = ClusterFindPlanarFaces(srf_design_faces=srf_top_faces)
cluster_find_planar_faces_2 = ClusterFindPlanarFaces(srf_design_faces=srf_bottom_faces)
pt_top_centroid_3 = Point(pt_top_centroid_2)
srf_bottom_planar_faces = Surface(cluster_find_planar_faces_2)
# notes: lets test that there is an intersection between the 2 breps
srf_top_planar_faces = Surface(cluster_find_planar_faces)
srf_bottom_planar_faces_2 = Surface(srf_bottom_planar_faces)
panel = Panel(srf_top_planar_faces)
panel_2 = Panel(srf_bottom_planar_faces_2)
srf_top_planar_faces_2 = Surface(srf_top_planar_faces)
# notes: To simplify the calculation we will only consider the dynamic compressive loading of the phone.
srf_bottom_planar_faces_3 = Surface(srf_bottom_planar_faces)
# notes: it is often useful to include the input and other byproducts available as output.
brep_top_3 = Brep(brep_top_2)
brep_bottom_3 = Brep(brep_bottom_2)
# notes: Let us identify which faces are facing 'up' and which faces are facing 'down'.  We compare the surface normal of the face to the direction of gravity, 'down'.
cluster = Cluster_3(srf_planar_faces=srf_top_planar_faces)  # -> srf_planar_faces_up_2, bool_output_equality_2, srf_planar_faces_down_2
cluster_2 = Cluster_3(srf_planar_faces=srf_bottom_planar_faces_2)  # -> srf_planar_faces_up_2, bool_output_equality_2, srf_planar_faces_down_2
srf_phone_planar_faces_down = Surface(cluster.srf_planar_faces_down_2)
srf_design_planar_faces_up = Surface(cluster_2.srf_planar_faces_up_2)
srf_phone_planar_faces_down_2 = Surface(srf_phone_planar_faces_down)
srf_design_planar_faces_up_2 = Surface(srf_design_planar_faces_up)
area = Area(Geometry=srf_design_planar_faces_up_2)  # -> Area, Centroid
# notes: make sure the point is on the surface
srf_cp = SurfaceClosestPoint(Point=area.Centroid, Surface=srf_design_planar_faces_up_2)  # -> Point, UVPoint, Distance
pt = Point(srf_cp.Point)
# notes: find the closest point in phone faces to the centroid of design faces.
# notes: result: closest points per phone surface
srf_phone_planar_faces_down_3 = Surface(graft(srf_phone_planar_faces_down_2))
srf_cp_2 = SurfaceClosestPoint(Point=pt, Surface=srf_phone_planar_faces_down_3)  # -> Point, UVPoint, Distance
pln_bottom_3 = Plane(pln_bottom_2)
# notes: if the distance is zero, the point in in the plane.
panel_3 = Panel("0.0")
num = Number(panel_3)
epsilon_equality = GhPythonScript(a=srf_cp_2.Distance, b=num)  # -> out, result; same code as epsilon_equality
panel_4 = Panel(epsilon_equality.result)
# notes: filter streams by the boolean 'point is in plane'
srf_design_planar_faces_up_3 = Surface(srf_design_planar_faces_up_2)
pt_closest_uv = Point(srf_cp_2.UVPoint)
pt_closest = Point(srf_cp_2.Point)
dispatch = Dispatch(List=pt_closest, DispatchPattern=epsilon_equality.result)  # -> ListA, ListB
dispatch_2 = Dispatch(List=pt_closest_uv, DispatchPattern=epsilon_equality.result)  # -> ListA, ListB
dispatch_3 = Dispatch(List=srf_design_planar_faces_up_3, DispatchPattern=epsilon_equality.result)  # -> ListA, ListB
# notes: these surfaces are common to both the phone and the stand, thus weight is transfered through these surfaces.
srf_common_faces_up = Surface(dispatch_3.ListA)
panel_5 = Panel(srf_common_faces_up)
panel_6 = Panel(dispatch.ListA)
panel_7 = Panel(dispatch_2.ListA)
srf_common_faces_up_2 = Surface(flatten(srf_common_faces_up))
pt_top_centroid_4 = Point(pt_top_centroid_3)
pln_bottom_4 = Plane(pln_bottom_3)
python = GhPythonScript(inputVar=srf_common_faces_up_2)  # -> out, result; same code as python
ma = MassAddition(Input=python.result)  # -> Result, PartialResults
larger = LargerThan(FirstNumber=ma.Result, SecondNumber=0)  # -> LargerThan, OrEqualTo
# notes: to test stability of this interface, we will test that the centroid of the phone is inside the convex hull of the common surfaces.
bool_hasintersection = Boolean(larger.LargerThan)
# notes: we will use the input plane as the projection plane for the centroid and the common surfaces.
pln_bottom_5 = Plane(pln_bottom_4)
pln_bottom_6 = Plane(pln_bottom_5)
project = Project(Geometry=srf_common_faces_up_2, Plane=pln_bottom_6)  # -> Geometry, Transform
srf_projected_common_faces = Surface(project.Geometry)
cluster_sample_curves = ClusterSampleCurves(srf_planar_faces=srf_projected_common_faces)
# notes: this is the area of the projected surfaces. a kind of approximation of the bearing surfaces for the phone.
area_2 = Area(Geometry=srf_projected_common_faces)  # -> Area, Centroid
pt_top_centroid_5 = Point(pt_top_centroid_4)
ma_2 = MassAddition(Input=area_2.Area)  # -> Result, PartialResults
num_projected_surface_area = Number(ma_2.Result)
cluster_3 = Cluster_4(pt_hull_points=cluster_sample_curves, pl_hull_plane=pln_bottom_6, pt_test_point=pt_top_centroid_5)  # -> pt_test_point_projected_2, pt_closest_point_to_hull_2, num_point_to_hull_distance_2, crv_hull_2, int_result_2, bool_point_in_hull_2
bool_hasintersection_2 = Boolean(bool_hasintersection)
format = Format(Format="{0:0.00}", Culture=127, Data0=ma_2.Result)
concat = Concatenate(FragmentA=format, FragmentB="mm²")
bool_hasintersection_3 = Boolean(bool_hasintersection_2)
int_result_of_point_in_hull = Integer(cluster_3.int_result_2)
bool_hasintersection_4 = Boolean(bool_hasintersection_3)
panel_8 = Panel(concat)
and = GateAnd(A=cluster_3.bool_point_in_hull_2, B=bool_hasintersection_4)
crv_common_surfaces_projected_convex_hul = Curve(cluster_3.crv_hull_2)  # "Crv common surfaces projected convex hull"
panel_9 = Panel(int_result_of_point_in_hull)
panel_10 = Panel(cluster_3.bool_point_in_hull_2)
R = ClusterOutput(and)
srf_projected_common_faces_2 = Surface(srf_projected_common_faces)
num_projected_surface_area_2 = Number(num_projected_surface_area)
num_point_to_hull_distance = Number(cluster_3.num_point_to_hull_distance_2)
txt_projected_surface_area = Text(panel_8)
pt_top_centroid_projected = Point(cluster_3.pt_test_point_projected_2)
pt_closest_point_to_hull = Point(cluster_3.pt_closest_point_to_hull_2)
srf_bottom_planar_faces_4 = Surface(srf_bottom_planar_faces_3)
srf_common_faces = Surface(srf_common_faces_up_2)
srf_top_planar_faces_3 = Surface(srf_top_planar_faces_2)
bool_breps_intersect = Boolean(bool_hasintersection_3)
pt_top_centroid_6 = Point(pt_top_centroid_4)
brep_bottom_4 = Brep(brep_bottom_3)
pln_bottom_7 = Plane(pln_bottom_4)
brep_top_4 = Brep(brep_top_3)
pt_top_centroid_projected_2 = ClusterOutput(pt_top_centroid_projected)
txt_projected_surface_area_2 = ClusterOutput(txt_projected_surface_area)
srf_common_faces_2 = ClusterOutput(srf_common_faces)
pt_closest_point_to_hull_2 = ClusterOutput(pt_closest_point_to_hull)
num_point_to_hull_distance_2 = ClusterOutput(num_point_to_hull_distance)
num_projected_surface_area_3 = ClusterOutput(num_projected_surface_area_2)
srf_projected_common_faces_3 = ClusterOutput(srf_projected_common_faces_2)
crv_common_surfaces_projected_convex_hul_2 = ClusterOutput(crv_common_surfaces_projected_convex_hul)  # "Crv common surfaces projected convex hull"
bool_breps_intersect_2 = ClusterOutput(bool_breps_intersect)
pln_bottom_8 = ClusterOutput(pln_bottom_7)
pt_top_centroid_7 = ClusterOutput(pt_top_centroid_6)
brep_top_5 = ClusterOutput(brep_top_4)
brep_bottom_5 = ClusterOutput(brep_bottom_4)
srf_top_planar_faces_4 = ClusterOutput(srf_top_planar_faces_3)
srf_bottom_planar_faces_5 = ClusterOutput(srf_bottom_planar_faces_4)

# ==== cluster ClusterVisualizeSupportProjection
crv_common_surfaces_projected_convex_hul = ClusterInput()  # "Crv common surfaces projected convex hull"
pt_phone_centroid_projected = ClusterInput()
pt_closest_point_to_hull = ClusterInput()
crv_common_surfaces_projected_convex_hul_2 = Curve(crv_common_surfaces_projected_convex_hul)  # "Crv common surfaces projected convex hull"
pt_phone_centroid_projected_2 = Point(pt_phone_centroid_projected)
pt_closest_point_to_hull_2 = Point(pt_closest_point_to_hull)
cir = Circle(Plane=pt_phone_centroid_projected_2, Radius=1)
ln = Line(StartPoint=pt_phone_centroid_projected_2, EndPoint=pt_closest_point_to_hull_2)
dash = DashPattern(Curve=crv_common_surfaces_projected_convex_hul_2, Pattern="3,3")  # -> Dashes, Gaps
swatch = ColourSwatch(SwatchColor=RGB(145, 0, 0))
len = Length(Curve=ln)
sph = Sphere(Base=pt_phone_centroid_projected_2, Radius=1)
srf = Surface(cir)
preview = CustomPreview(Geometry=srf, Material=swatch)
preview_2 = CustomPreview(Geometry=ln, Material=swatch)
preview_3 = CustomPreview(Geometry=dash.Dashes, Material=swatch)
preview_4 = CustomPreview(Geometry=sph, Material=swatch)

# ==== cluster ClusterFindPlanarFaces
srf_design_faces = ClusterInput()
srf_design_faces_2 = Surface(flatten(srf_design_faces))
planar = IsPlanar(Surface=srf_design_faces_2, Interior=True)  # -> Planar, Plane
dispatch = Dispatch(List=srf_design_faces_2, DispatchPattern=planar.Planar)  # -> ListA, ListB
srf_design_planar_faces = Surface(dispatch.ListA)
srf_design_planar_faces_2 = ClusterOutput(srf_design_planar_faces)

# ==== cluster Cluster_3
srf_planar_faces = ClusterInput()
srf_planar_faces_2 = Surface(srf_planar_faces)
area = Area(Geometry=srf_planar_faces_2)  # -> Area, Centroid
srf_cp = SurfaceClosestPoint(Point=area.Centroid, Surface=srf_planar_faces_2)  # -> Point, UVPoint, Distance
evalsrf = EvaluateSurface(Surface=srf_planar_faces_2, Point=srf_cp.UVPoint)  # -> Point, Normal, UDirection, VDirection, Frame
srf_planar_faces_3 = Surface(srf_planar_faces_2)
srf_planar_faces_4 = Surface(srf_planar_faces_2)
pi = Pi(Factor=1)
Z = UnitZ(Factor=1)
division = Division(A=pi, B="2.0")
rev = Reverse(Vector=Z)
num = Number("1.00001")
num_2 = Number("0.99999")
multiplication = Multiplication(A=division, B=num)
multiplication_2 = Multiplication(A=division, B=num_2)
angle = Angle(VectorA=rev, VectorB=evalsrf.Normal)  # -> Angle, Reflex
larger = LargerThan(FirstNumber=angle.Angle, SecondNumber=multiplication)  # -> LargerThan, OrEqualTo
smaller = SmallerThan(FirstNumber=angle.Angle, SecondNumber=multiplication_2)  # -> SmallerThan, OrEqualTo
dispatch = Dispatch(List=srf_planar_faces_4, DispatchPattern=smaller.SmallerThan)  # -> ListA, ListB
dispatch_2 = Dispatch(List=srf_planar_faces_3, DispatchPattern=larger.LargerThan)  # -> ListA, ListB
panel = Panel(dispatch_2.ListA)
srf_planar_faces_down = Surface(dispatch.ListA)
panel_2 = Panel(dispatch.ListA)
srf_planar_faces_up = Surface(dispatch_2.ListA)
equals = Equality(FirstNumber=dispatch_2.ListA, SecondNumber=dispatch.ListB)  # -> Equality, Inequality
bool_output_equality = Boolean(equals.Equality)
panel_3 = Panel(equals.Equality)
srf_planar_faces_up_2 = ClusterOutput(srf_planar_faces_up)
bool_output_equality_2 = ClusterOutput(bool_output_equality)
srf_planar_faces_down_2 = ClusterOutput(srf_planar_faces_down)

# ==== cluster Cluster_4
pt_test_point = ClusterInput()
pl_hull_plane = ClusterInput()
pt_hull_points = ClusterInput()
pt_test_point_2 = Point(pt_test_point)
pl_hull_plane_2 = Plane(pl_hull_plane)
pt_hull_points_2 = Point(flatten(pt_hull_points))
hull = ConvexHull(Points=pt_hull_points_2, Plane=pl_hull_plane_2)  # -> Hull, HullZ, Indices
project = Project(Geometry=pt_test_point_2, Plane=pl_hull_plane_2)  # -> Geometry, Transform
crv_cp = CurveClosestPoint(Point=project.Geometry, Curve=hull.Hull)  # -> Point, Parameter, Distance
incurve = PointInCurve(Point=project.Geometry, Curve=hull.Hull)  # -> Relationship, Point
num_point_to_hull_distance = Number(crv_cp.Distance)
pt_closest_point_to_hull = Point(crv_cp.Point)
pt_test_point_projected = Point(project.Geometry)
crv_hull = Curve(hull.Hull)
filter = StreamFilter(Gate=incurve.Relationship, Stream0="False", Stream1="False", Stream2="True")
bool_point_in_hull = Boolean(filter)
int_result = Integer(incurve.Relationship)
pt_test_point_projected_2 = ClusterOutput(pt_test_point_projected)
pt_closest_point_to_hull_2 = ClusterOutput(pt_closest_point_to_hull)
num_point_to_hull_distance_2 = ClusterOutput(num_point_to_hull_distance)
crv_hull_2 = ClusterOutput(crv_hull)
bool_point_in_hull_2 = ClusterOutput(bool_point_in_hull)
int_result_2 = ClusterOutput(int_result)

# ==== cluster ClusterSampleCurves
srf_planar_faces = ClusterInput()
srf_planar_faces_2 = Surface(srf_planar_faces)
# notes: divide the curve into segments length mm long.
number_slider = Slider(2, range=0..6)
debrep = DeconstructBrep(Brep=srf_planar_faces_2)  # -> Faces, simplify(Edges), Vertices
midpt = CurveMiddle(Curve=debrep.Edges)
divlength = DivideLength(Curve=debrep.Edges, Length=number_slider)  # -> flatten(Points), Tangents, Parameters
merge = Merge(Data1=debrep.Vertices, Data2=divlength.Points, Data3=midpt)  # -> flatten(Result)
pt_edge_samples = Point(merge)
# notes: filter streams by 'point in plane'
pt_edge_samples_2 = ClusterOutput(pt_edge_samples)
